# Grasshopper definition test_gates.gh (Grasshopper 1.0.7)
# plug-ins: Dynamic Data Tools

panel = Panel("""True
False
True
False""")
panel_2 = Panel("""True
False
True
False""")
panel_3 = Panel("""False
False
True
False""")
panel_4 = Panel("""True
False
False
False""")
flatten = FlattenTree(Tree=panel, Path="{3}")
flatten_2 = FlattenTree(Tree=panel_2, Path="{2;1}")
flatten_3 = FlattenTree(Tree=panel_3, Path="{1}")
flatten_4 = FlattenTree(Tree=panel_4, Path="{0;45}")
merge = Merge(Data1=flatten_3, Data2=flatten_2, Data3=flatten, Data4=flatten_4)
panel_5 = Panel(merge)
boolean_gate = BooleanGate(Bool=merge)
boolean_gate_2 = BooleanGate(Bool=Slider(0, range=0..10))
rec = DataRecorder(boolean_gate, DataLimit=-10, RecordData=True)
rec_2 = DataRecorder(boolean_gate_2, DataLimit=-10, RecordData=True)
panel_6 = Panel(rec)
panel_7 = Panel(rec_2)
panel_8 = Panel("""1
2
3
4""")
panel_9 = Panel("""1
2
3
4""")
panel_10 = Panel("""1
2
3
4""")
panel_11 = Panel("""1
2
3
4""")
flatten_5 = FlattenTree(Tree=panel_8, Path="{3}")
flatten_6 = FlattenTree(Tree=panel_10, Path="{2;1}")
flatten_7 = FlattenTree(Tree=panel_9, Path="{1}")
flatten_8 = FlattenTree(Tree=panel_11, Path="{0;45}")
number_slider = Slider(7, range=0..10)
timer = Timer(TimerInterval=100, Target=number_slider)  # disabled
merge_2 = Merge(Data1=flatten_7, Data2=flatten_6, Data3=flatten_5, Data4=flatten_8)
panel_12 = Panel(merge_2)
integer_gate = IntegerGate(Int=merge_2)
integer_gate_2 = IntegerGate(Int=number_slider)
rec_3 = DataRecorder(integer_gate_2, DataLimit=-10, RecordData=True)
panel_13 = Panel(integer_gate)
rec_4 = DataRecorder(integer_gate, DataLimit=-10, RecordData=True)
panel_14 = Panel(rec_3)
panel_15 = Panel(rec_4)
